# Grasshopper definition main.gh (Grasshopper 1.0.8)

facade_type = ValueList({"One": 1, "Two": 2, "Three": 3, "Four": 4, "Five": 5, "Six": 6, "Seven": 7, "Eight": 8, "Nine": 9, "Ten": 10}, selected="Seven")
facade_type_2 = ValueList({"One": 1, "Two": 2, "Three": 3, "Four": 4, "Five": 5, "Six": 6, "Seven": 7, "Eight": 8, "Nine": 9, "Ten": 10}, selected="One")
facade_type_3 = ValueList({"One": 1, "Two": 2, "Three": 3, "Four": 4, "Five": 5, "Six": 6, "Seven": 7, "Eight": 8, "Nine": 9, "Ten": 10}, selected="Three")
facade_type_4 = ValueList({"One": 1, "Two": 2, "Three": 3, "Four": 4, "Five": 5, "Six": 6, "Seven": 7, "Eight": 8, "Nine": 9, "Ten": 10}, selected="Seven")
sample = Geometry([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])
boolean_toggle = BooleanToggle(False)
sample_2 = Geometry(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)
facadegenerator = Python3Script(
    script=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,
    building_breps=sample,
    floor_height=Slider(4, range=0..10),
    pattern_length=Slider(3, range=0..10),
    pattern_ratio=Slider(0.8, range=0.1..0.9),
    pattern_depth=Slider(0.6, range=0.1..2),
    pattern_types=[facade_type, facade_type_3, facade_type_2],
    variation_factor=Slider(0.3, range=0..1),
    bake_block=Button())  # -> out, walls, glasses, frames; inputs building_breps: list of Brep, floor_height: Double, pattern_types: list of Int32, bake_block: Boolean; unedited script template
facadegenerator_2 = Python3Script(
    script=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,
    building_brep=sample_2,
    floor_height=Slider(4, range=0..10),
    pattern_length=Slider(3, range=0..10),
    pattern_ratio=Slider(0.8, range=0.1..0.9),
    pattern_depth=Slider(0.6, range=0.1..2),
    pattern_type=facade_type_4,
    bake_block=Toggle(False))  # -> out, walls, glasses, frames; inputs building_brep: Brep, floor_height: Double, pattern_type: Int32, bake_block: Boolean; disabled; unedited script template

geometry = Geometry(facadegenerator.glasses)
geometry_2 = Geometry(facadegenerator.walls)

geometry_3 = Geometry(facadegenerator.frames)

geometry_4 = Geometry(facadegenerator_2.glasses)
geometry_5 = Geometry(facadegenerator_2.walls)

geometry_6 = Geometry(facadegenerator_2.frames)
panel = Panel(facadegenerator.out)
panel_2 = Panel(facadegenerator_2.out)
custom_preview = CustomPreview(Geometry=geometry_2, Material=ColourSwatch(SwatchColor=RGB(161, 161, 161)))
custom_preview_2 = CustomPreview(Geometry=geometry, Material=ColourSwatch(SwatchColor=RGB(0, 64, 255)))
custom_preview_3 = CustomPreview(Geometry=geometry_3, Material=ColourSwatch(SwatchColor=RGB(255, 71, 71)))
custom_preview_4 = CustomPreview(Geometry=geometry_5, Material=ColourSwatch(SwatchColor=RGB(161, 161, 161)))
custom_preview_5 = CustomPreview(Geometry=geometry_4, Material=ColourSwatch(SwatchColor=RGB(0, 64, 255)))
custom_preview_6 = CustomPreview(Geometry=geometry_6, Material=ColourSwatch(SwatchColor=RGB(255, 71, 71)))
